# Grasshopper definition originaltree5.ghx (Grasshopper 0.9.76)

# Prevent this misunderstanding that because you're typing a message to a friend on your computer, that the message is only available to you and your friend
# 
# no. make it clear that the message is sitting on FACEBOOK (or whoevers) server and show whether THAT keyholder has access to the data you're typing
# 
# because there are other instances where your data will be stored on a service, but that keyholder doesn't have access to your data
# 
# and that's kind of a complicated thing to explain to a user, but it could be made clear from the design of the textree
# Good Resource / Things to Fork
# 
# Behavoir3 JS Tree Editor
# 
# Node Garden
# This is a hash combination lock
# 
# speed dial
# 
# you can push the center in any direction and it will push each gear a little differently (one gear moves a lot, side gears move half as much, one gear doesn't get touch)
# 
# and the amount each gear  moves relies on the push of the center as well as the current state of of the gear. For random guesses, for a complex combination, The position may never happen
# Every time I chmod I have to google or man page it or just take a few steps to think about it
# 
# the way that chmod has been contained to a CLI, unlinked from help, necessitating that you're a technically literate user to whom it makes sense that a single decimal digit can represent multiple possible states
# 
# As a user of your own branch, you can edit your personal documentation, which can be shared if you wish.
# 
# the man pages act as a wiki, and if further understanding is needed, the source code is available for perusing (which you can also make comments about! and collaboratively explore and explain to each other, and hide the branches that don't make sense and promote the branches that you like
# 
# usefullness bubbles upstream
# Sing 'world of pure imagination' soon after starting a tour of the forest visualization
# 
# where the growth of data and community is exposed in real time
# 
# your friends can have insect avatars (or regular avatars I guess) that roam around whatever tree theyre contributing to (here, even accessing the page is providing bandwidth and an audience
# OMG the plants stay alive by getting accessed
# 
# dead communities are easily recognizable by their wilt
# 
# but can be built, archived, even replayed
# The regular net is like ice burgs floating, freezing, melting, but with little proof of life. A dark underbelly of disconnected and unreachable information, tiny protozoa drifting by each other, stale and apathetic
# 
# This could be visualized by the same rending engine showing the garden teeming with life
# Option to produce new path by ordering existing nodes. For composition, compiling, and publishing. Have this big map of possibilites but decide, I want to publish something. Click "ORDER" and select the nodes in the order you want them to be structured linearly, and then publish.
# 
# A new tree is created consisting of links to the original (It is a bit of a mirage in this case)
# Assisted content ordering
# 
# search for plant (the living kind) and find all nodes related to plant
# 
# sort by timeline
# 
# or closeness
# 
# or relevance
# 
# or any other strategy you want to prototype or grab from some other repository
# 
# there is no more central search engine
# Screen savers to watch progress, an active representation of activity. Could be of forums I'm a part of, just by watching the flowers bloom I can tell that there's a burst of information, or really slow growth.
# 
# This could apply to automatic scrapers, like putting a 'watch' on trees that I follow, to see that sudeenly there's a thosand new leaves on my feed for a city that I want news about, or a topic that I follow (hashtags become flowers)
# Concept Art
# Putting megacorps out of business by making them irrelevant is possible by giving away your invention for free. (especially when that invention is self-multiplying and designed to adapt to its environment faster and stronger than whatever is feeding off it now)
# 
# Capitlism has sucked people's drive for purpose dry, the environment is no longer suitable for growth
# 
# the environment is suitable for improvisation and gifts and good food
panel = Panel("protected private public")
# Every time I close my eyes I think of something that makes me wake up thinking 'it would be incredible if this thing existed' or 'whoa, what if it worked like this?'
# Just the thought that plants / gardens / insects offer a supremely rich feature set for visualizing complex processes
# parent nodes can be collapsed, offering custom styles of summarizes contents. List immediate children, list family, summarybot etc
# Start paying attention to how much data you use, every time you re-load facebook, every time you go back to a forum post you remembered, you're spinning up a harddrive somwhere else, drawing current on a dozen data centers routing your call. That's coal burned for every megabyte transmitted.
# 
# It drives me mad that we've went down this path of assuming constant connection to all our content, which means using the backbone every time we want to share something, or check something. But contemporarily the hosted solution is the more used friendly one, the more reliable one. That's what I'm trying to change here, give the advantages of environmental friendliness and privacy of locally hosted applications while not berating the user and expecting them how to handle their firewall and choose which ports to open and compile shit before they can get encryption keys.
# DNA is linear storage, but sophisticated in its storage strategies
# I was raised somehow believing that computers were a viable form of life, that the processes of growth and learning and clever decision making were not unique to humans
# When creating a new node, intellisense finds functions, but also finds names of other nodes, in order to easily link
# Oh yeah, when you publish via an order-chain, working on the original tree, those nodes can be highlighted, and children can be inserted into that order at any time, automatically updating the published content.
panel_2 = Panel("Nodes start out as plain text, key terms are recognized and the node may offer to become that function via drop down, like intellicode. ")
# The Patent to end all patents
# 
# submit a patent for a universal content management system that allows for forking,
# The biggest disrumption in computing since relational databases
# Import HTML or XML
# 
# the DOM tree is broken up into the child nodes, giving an immediate visual representation of its structure.
# 
# From there you can create global filters to change what is expressed, and set rules to certain attributes ('tag is...' 'nth child' 'contains the phrase'
# 'does not contain the phrase'
# 
# graft the data to the root of a new tree to export what you wanted
# Essentially it's a blueprint for an operating system that dislocates data from interface. It's stupid to have a filetype that can only be edited with one poorly designed interface.
# 
# By making the UI a fully user editable, datatype-agnostic skin, users can work on data in whatever way makes sense to them
# 
# plain text, automagic, friendly kid buttons, power user drop down menus, menus organized and sorted whatever way you want
# 
# functions that you can peak at and change the functionality to make it work for you
# 
# have those changes be traversable by other users of the root program (or interface) to build on and use for themselves
# If you clone a site and THEN search it, no one can watch you, no information is returned about WHICH information you look at, your behavoir can't be tracked
# Functions can render to the workspace. Options: divorce
# Functional trees can be folded into a single node. The branches are conditionals that return a result to an outlet (holy shit a live tree with flowers and falling leaves could represent data flow and work as a debugger)
# I don't have to start a new web platform and build a hosted editing platform for every new file format(ply, latex, etc) - the data type is all the same, any rendering engine can read it.
# I don't want to repeat the mistake of diaspora
# 
# Tell everyone the plan too early
# 
# rollout fails, did not scale as expected, people didn't create their own nodes (technical process)
# Just tried showing mom some photos that I was just looking at when the internet dropped out
panel_3 = Panel("if no function is selected, automatically be a plain text nodes")
# as content is added byte by byte, a branch grows slowly, correlating in size, reminding you how much content you have unsaved. Closing the window or hitting ctrl s creates  a little circle representing a node, kinda looks like a subway map, the save points are git commits, traversable and forkable
# rendering nodes have the option to be gloabal aware, essentially all nodes are being piped to it, but to keep performance desirable, it just reads the hashes - the relationship information
# Normal filesystems do this, the data is a list with metadata, the file explorer gives you different ways to navigate through the files
# 
# this is just extending this concept into the files themselves, as they're just more lists of chars that can be interpreted however you tell them to be
# I wonder if there's an automatic way to test whether a change breaks the mainline
# 
# or what will break by changing this function
# 
# hard problem
# 
# test driven design is related
# VB script
# 
# it's great don't get me wrong
# 
# grasshopper devs ya'll the real mvp
# 
# but it doesn't give the ability to change the core functionality of the program (how linked lists act)
# When I'm excited and putting down ideas I'm freaking paranoid that I'm going to lose my progress because I'm never going to have that idea again
# 
# I have the sensation every day of having a pleasant passing thought and then wishing I could remember what it was, and it used to frustrate me so much, like when a word or the name of a movie is on the tip of your tongue and you just can't move on because you want so badly to finish the thought, but I've learned to let go and just hope something triggers the memory.
# 
# But this set up, with live mics continuously storing words and thoughts, maybe that's a thing of the past like engelbart and others wanted
# Why even have a citation if you're not going to clone the website to make sure the original source is going to stick around
# 
# stuipd stupid stuipd
# 
# if you want to be an editor you have to be a host, or have a hosts in person permission
# Back on that accessibility train
# 
# with VR goggles, possibily paired with even relatively rudimentary computers / smartphones, people with limited mobility could don the helment, and instead of turning their head to look around, they could turn their view to have the experience of looking around.
# 
# And they can choose their body
# 
# And they can have a mind maps of how they want their avatar computer body to interface with their neural implant or whatever.
# 
# And I think this combination, of making decisions about what kind of body you want (a butterfly, an elephant, superman, I don't care) along with the process of tinkering with functions on your neural interface might lead, with enough plasticity, to understand how to rewire your own nervous system
# 
# So when your avatar moves you feel it, REALLY feel it. you can probably start to leave your body and experience this other one. And that's pretty freaky VR wise to me, someone who really enjoys running around in the world, but it would be a godsend for the bedridden
# 
# 
# and maybe, by putting sensors on your body, and playing with various ways of representing the sensor readings in your forest, and by sicking learning algorithms to see multidimensional patterns you cant, you can train yourself & the computer
panel_4 = Panel("oh and the boxes automatically scale, unlike Grasshopper")
# When a word or phrase is used that matches something that has already happened (like excel autofilling cells) offer an option
# Toggle option:
# Do you want the text to get smaller as you go, or the box to get bigger?
# 
# Do you want the focus to follow the box?
# 
# The box can scale and push other boxes out of the way.
# Maybe I'm the first one to have used
# 
# pd
# git
# antimony
# grasshopper
# eve
# JIT compilation
# bittorrent sync
# mindmap
# freenet
# whatever steve's thing is called
# I hated my google docs experience
# 
# I was working on my version of code that was only executable on my system, Virginia was remote, doing the same thing, we were copy pasting revisions into a google doc, and I was like, "oh I have a different idea I want to try" (fork) so I was trying to make a new document and put it in the same folder, and I just couldn't figure out how to go 'up' from where I was
# Grasshopper taught me everything about iterative prototyping with functions, dataflow, and datatrees
# 
# Handy middle click for useful tools
# 
# But it's dumb to double click, type panel, double click, start typing
# 
# it's just enough context switching (remembering how to use this program) to lose my train of thought
# 
# if I had control of the event listeners
# Inspired by facebooks distallation of privacy protection, Public? Friends [group you control the keys of]? Only You? [key only exists on local machine] Custom: Whitelist / Blacklist. Simple. Good job facebook.
# 
# Now if only it were actually encrypted and the privacy controls actually, provably protected your privacy
# There's literally not a tool for me to begin to understand the news
# 
# to see headlines referencing car bombs in baghdad and email leaks, hell even police shootings
# 
# creater, aggregator, curator
# Inkscape feature where you mouseover a node and scroll to select adjacent nodes for purposes of cloning, pruning, and styling.
# For instance, to keep a sturctural representation of data branches but sort of scaling to push it out of the way, the default behavoir could be to squeeze the orginally selected node, and squeeze adjacent nodes less and less along a bell curve whose sd I can scroll up and down to change.
# I like to keep my leaves bite sized, with the data contained represented as smaller and smaller text so I can see the information density
# Traversing the tree with keyboard shortcuts, vim style, /:03,05,08 or 'seconds node of branch 5' or 'this nodes first grand daughter'
# Another inspiration was that Snowflake tattoo game
# 
# and some weird pictures I took at the Hillsboro BBQ
# 
# that reminded me that there's a really fabulous aesthetic to creative representations of reality
# 
# I'm dogmatically opposed to photographs and video. I think simulations that accurate fool us, make us lose our footing, make us unsure of what's in front of us. We see and hear ghosts.
# 
# It should always be obvious that the content you're manipulating is unreal, is manufactured and designed, does not can not represent the objective truth.
# 
# An embedded philosophy of the personal nature of representation.
panel_5 = Panel([panel_3, panel_2, panel_4])
# A Moment of Silence to Synchronize Our Clocks
# 
# And so, some bubble sort algorithm in which each phone beeps loudly, and listens for other beeps before and after. In this way, each phone knows if it was a little early, or a little late, and tries again to place itself in the center of the event distribution
# 
# The grouping will be way tighter the second time
# 
# and maybe by the third time they'll all produce a tone at once
# 
# the signifier and musicality of this process can be modified to suit the group using it.
# Context Aware Malware
# Entity Identification
# 
# Identify file type (say, a pdf that mostly renders to text) and crawl over the text to find executable structures that look out of place
# Calendar / Meal Planning
# 
# You can make your meal plan. Duplicate things. Repeat things.
# 
# Use other people's RECIPE TREES, choose which recipes you want to use, fuzzy matches determine necessary ingredients: produce shopping lists for however many days you want, even find optimum times to purchase. Tag how many people will be there on each day. If more or less people will be there, automatically fluctuate ingredients needed.
# Right now it's just boxes.
# 
# You gotta start somewhere.
# 
# Might as well be a box.
# I'm assuming I live in a culture where people aren't sued or jailed for using other people's ideas. But. Are tree paths patented? The use of the tree and branch logos to represent those relationships, is that patented?
# 
# contact
# David Rutten
# david@mcneel.com
# An important contribution to make will be manually connecting multiple thougths and describing what they mean
# 
# manual description and tagging and networking of someone else's content
# 
# branching a few paragraphs and describing where that idea comes from
# 
# branching separately two sides of an argument and describing what their arguing about
# 
# people could be giving these metadescriptors the people arguing might see how they're being interpretted by different sides
# I want to expose the guts of servers to end users
# 
# go ahead, open a terminal and poke around
# 
# there should be no security through obscurity, crossing your fingers no one goes poking around your server
# 
# you should lock down the server with the expectation that people will be snooping
# 
# because humans are curious, and that's a good thing
# multilingual conversations can occur in the same vectorspace
# 
# you could be accessing the same domain and working independently, that's a good way to do it
# 
# but it would be a terrifically fun place to be where people are acting together, watching each other type and sort
# If you have a mic on your machine and I have a mic on my machine, the server can determine who is talking when and add their conversation naturally, which anyone else could be sorting and correcting as they go
# People have different preferences for how they navigate conversations, if they're acclimated to old forum lists, or if they demand full folding threads, or if they want to upvote, or want to talk to strangers etc etc
# 
# This could involve connecting your contributions to a public article, and you could device to make public comments but only view comments made by friends or friends of friends
# 
# or only view comments from people from your GEO IP
# 
# or only allow your comments to be views by people on a MAC address whitelist
# add a box that links to an URL, inhales the DOM, breaks the content into trees
# 
# you can prune the tree (training content ML at this time about what different kinds of content looks like)
# 
# but basically the readability algorithm and then split the content into a flat tree and allow you to organize it from there.
# OK
# 
# JS Fabric
# MeteorJS? So that things happening on one PC can be sync'd to others right away
# Double click to create new boxes, type in the boxes
# save boxes to plain text file
# save relational structure as text file
# connect boxes will funny sine waves
# find a method of data flow: link list, prepending up the chain?
# create a filter function
# create a split function
# 
# add that annyang business. (back to SSL　busniess)
# 
# create a function that can be used right away...
# 
# determine a way to add styling
# there's a tool called global faucet, or maybe as an option, anyway, some way of saying 'I'm about to do something to everything', such as forking, and then global machine translation.
# Side business selling happy hacker keyboards with vintage televisions, raspbery pi with RF modulator. The vector net will work great.
# AI is going to be scraping case law
# 
# but AI that uses textree structure is going to do it better
panel_6 = Panel("""歜守門戶
吸乃戊台夕夕匕屹堵仍凡丑　    """)
# When there's only one option (double click on read only leaf, but comments allowed) just do the default option, double click on a comment to make a child-comment. Shortcuts to navigate act like single click. Select siblings, cousings, etc.
# Virtual reality is going to be a certain devious variety of addiction
# 
# it's primary utilization is the simulation of fantasies. scary games, glorious games, but largely games which simulate an experience you could conceivably have as a human.
# 
# Therefor, it will always be dissapointing to leave it.
# 
# To be reminded that the real world is unsatisfying
# 
# I think it will be important to design VR experiences that are distinct from actual reality
# You don't have to be a convert, you don't have to forsake your friends
# 
# You can write and share scripts, update scripts that everyone else
# 
# If they can write programs that pretend to be people, you should be allowed to write programs that pretend to be YOU
# 
# javascript that accesses a page, enters logon credentials, move the mouse around a little bit, copies data to textree. When you add
# 
# All the users have direct access to the source code and can notice a bug and suggest a fix. Users can switch from one branch to another and SEE other users flocking to a fixed branch
# 
# so if you successfully communicate with your friends and have trees and trees of friendship (lol) then facebook makes an adjustment and breaks a feature, you're not SOL, and you're not waiting for a single developer who's abandoned the software to fix it. You can create sidechains of the mainline discussing the problem collaboratively, making hundreds of forks to play around with it,
# 
# Oh my god like Trillium. I use it because it allows me to use many services at once.
# Log is a slice of a tree
# Access controls exposed to the end user:
# 
# ban simultaneous contributions?
# ban identical contributions?
# how about nearly-identical contributions?
# limit # of contributions by new user, like many forums do. Give access priveges by the attributes of that user's activity log
# The major selling point of TexTrees
# 
# Well, selling point isn't the right word because I'm giving it away for free, what's a better phrase...
# 
# the adoptation point of TexTrees is that instead of trying to inspect the code and figure out, ok it's a canvas element and here's some events that occur, which is practically
# 
# This is an operating system designed in a parallel universe where bitmaps and binaries were never invented
# 
# instead, we have strong encrytion, just in time compilation, and a free society where sharing and building on each others data is taken for granted.
# The original domain owner can set append and bandwidth access limits
# 
# as a page jumps in popularity, and/or as the server becomes taxxed
# 
# a page is served instead: "The owner of this tree has reached serving capacity. If you would like to view this page, please offer your domain as a host."
# 
# Page gets cloned, rehosted, and the new domain address is forwarded to the original server so it can redirect traffic. If that new host helps a little or a lot its fine, traffic will be redistributed, other domains will get shared so even the DNS rerouted gets distributed, probably
# 
# in this case newssites cloning news becomes a Very Good Thing
# Cloning and Backing up just becomes the norm, the usual, the obvious.
# 
# the potential for averting data loss is enormous
# 
# websites don't go offline anymore
# 
# content doesn't get changed without proof it ever existed
# VERY GOOD THING
# Double sided rich text nodes, a box where text can be italicized, linked, styled etc and the charwise representation (VS bitwise representation) is displayed on the other side
# Oh yeah every leaf can have any number of tags
# Ultra cache is the assumed norm.When you want to refresh a page to see if there's anything new, you just have to check what branch you're on (does this get enormous for social media?) And load new content
# 
# You can create content (respond to posts, make edits to a collaborative doc) and push your contribution later
# 
# oh yeah, it's still called a contribution
# The style layer will work on any content tree.
# 
# If you clone it and sick it on your trees and it looks like crap, you may have to rearrange the data to match the expectation of the stylesheet (like, 1st children are headers, biography has to be tagged biography instead of bio
# On lockpicking demonstrations and public understanding
# 
# It's important to know that locks do not protect you, and your security is simply a matter of who is more concerned about breaking in. The lock? Or the lockpick? Who gives up first?
# 
# Don't be an easy target.
# On facebook messenger
# 
# I'm really good at picking exceptionally cheap locks
# And with some patience I can pick normal house deadbolts
# there were some real experts just chilling out teaching hackerspace style
# i loved lockpicking village. a place to chat with strangers while you try something new together.
# 
# Then I thought, oops, hope that's not of interest to the government
# 
# because if they want to frame me for a recent break in, they can subpeona my facebook records and say "see, jurors, just a week before the break in Colten told his closest confidant that he was capable of picking a common deadbolt lock"
# 
# So like it doesn't matter that I don't commit crime, governments fabricate evidence all the time
# 
# So surveillance SHOULD change the way you speak online, as long as you can be reasonably certain the government is spying on you --> data collection will never be outlawed as long as corporations do the job of collecting and storing behavoiral data for free that the government is free to peruse
# With a local clone of youtube directories (which can be updated on schedule, whatever) the application hosted on someone else's domain doesn't have to know which video I'm watching or how often I watch it to make recommendations to me
# Fabulous Grasshopper bug: When editing a panel, you can zoom in and out and it determines direction of zoom by placement of cursor while the edited panel floats in the center of the screen, allowing kind of a nice way to move around the tree while editing a single node. Placement of the node in the new location is optional
# In the cases where you're flipping a panel, or dealing with rescaling text, etc, the relevant configuration node from another sheet should peak into view, to hint that there are options associated with this operation
# ROOT USER GROUP chmod permissions in effect
# 
# 777 DO WHAT YOU WANT
# 774 YOU CANT RUN THIS CODE (non executable by individual users)
# 711 only admin has power over this content
# 
# Total transparancy over who has what rights
# You should also be able to jump around in an orderly way based on your own timeline, ie, what was I just looking at?
# 
# Alt Tab for mind maps
# Please tell me to what degree I'm being a reckless asshole?
# Threads can peak in and out of privacy, just like how you might whisper to someone next to you in the middle of speaking to a group.
# 
# It sucks that those conversations lose contexts when they take place in different platforms, like public comments vs private messenger. Also, why the hell did the giants do away with timestamps? Facebook and Gmail, I have to work to find out when a message was sent. Bullshit.
# vimesque tree nagivation: command mode. Down how many generations? First child? Last Child? Next Previous, Up Down, Parent. Bloodline, or ordered mode? When orders are created, the nodes can exist anywhere in space, but jumped
# you will be able to visualize the bots. They will appear on your network with certain characteristics. Maybe machine learning identifies suspect traffic patterns, maybe there is a web of trust of known human users (In person key swaps ensure that avatars are associated with the person you expect them to be)
# 
# You know when someone else is looking. And it should spook you the fuck out.
# I like how in grasshopper you can zoom in close for panel settings to appear
# I fucking love that the documentation pops up when you mouseover a function
# But actually in the final version the desc/doc will be one side of the panel
# Presenting it to hackers and open source proponents because I want to find a lot of people quickly who will adopt this
# 
# 
# cats out of the bag, done gone ran up a textree.
# Is it crazy to follow the git model tightly? Generate branches for every child node? That's probably not consistent with the structure of sibling nodes and loopback relations (though maybe git should be made consistent with this?)
# OneNote, EverNote, Google Keep, they're OK, they do what a lot of people need, but it's rather clunky to move things
# Super inspired by Inkscape. Extensible by anyone so you can add functionality as an end user. Files are saved as plain text XML by default making them universally read/writable. I can manually Find/Replace tags and attributes. I can copy paste the whole thing into my web browser. Amazing.
# 
# Only trouble is the default tools don't expose their source code for the user to learn from and modify core functionality (only extensions, unless you want to recompile)
# 
# Also there's not really any potential for parametric design, so certain things are super tedious
# 
# Accessibility is poor. To make the same codebase usable by little kids, grandparents, and whippersnappers with good eyesight, the interface should be more reconfigurable.
# The comment doesn't say edited or non edited
# 
# it says edit history available, and shows every chain available, or it shows edit history not available, and you're out of luck, the history is private, domain owner's perjogative
# 
# The appending of comments to a particular branch allows latecomers to understand whether a comment was made before an edit was made.
# 
# This solves the problem of assholes on reddit creating a compelling, upvoted comment, and then switching it out to nazi propoganda.
# Antimony changed my life. Not only can you whip up new functionality on the fly, you can peak and modify that core system functionality from anywhere.
# 
# Wonder what function this button calls, what argument it takes, what errors it produces, what algorithm it uses? METAclick to expose the function, with documentation on one side and source code on the other
# Right now global sentiment analysis is available at extraordinary costs to extraordinarily priveleged individuals of spy agencies and multinational corporations.
# 
# The spy agencies use it to target you
# the corps use it to sell shit
# 
# but how would artists and community organizers and anthropologists use that data?
# 
# it's super bullshit that the bleeding edge technology is only available to people who can afford a $10,000 / month API
# the domain owner has total control over the permissions and permission-flexibility of new nodes made by other users / groups on their own domain.
# Regarding my preferences for whether people notice that I looked at their message, there can be some configuration about what your domain reports to a comrads domain. If you're working closely with people and do want your system to automatically report that the message was seen, and that a response has been attached but not pushed, that's an important feature
# 
# but for conversations to have this weird tailing timing happen where I know a person looked at a message and I'm waiting for them to respond? I hate it, I'd rather they not know if I didn't look for a few days
# Rendering can be done on a per tree basis, or on a global basis, or a domain basis, whatever
# 
# rendering rule sets are matched to attribute sets
panel_7 = Panel("vector net")
# Makes it trivial to encrypt the content while sharing the rendering engine, so whatever content a user has the key to can be rendered how you want, but that content is stored totally separate from the rest of your server (in fact it may not even exist on your server)
# I've been surrounded in the hacker/maker culture by the concept that I own my own hardware, to repair and reconfigure as I want. To assert control over how my harwdware works, and that includes what data goes in and out of my machine. No one has a right to connect to me, so I use a HOST file, ad servers have no right to transmit to my screen, I never asked for their content
# sure most people sign on to this social contract wherin they trade their eyeballs to advertisers in exchange to rent a little server space (but the exchange is misrepresented of course, because that server sells their data too, so in any case their selling the behavoir markers to advertisers in exchange for a platform to share their thoughts, which I find abhorrent
# Good joke: upon familty tree structure by voice, if asked "how old so and so" "how tall so and so" like those old math problems, just give it a good guess. Something based on the information maybe. If they're a grandparent they must be old if their a boy they're probably so tall
# Oh shit fractal nature of plants, man, veins in the woods, branches of a tree, outbranching of the leaves, veins of the leaf, structure and branching of veins, macromolecules/proteins/DNA like how far do you want to go man?
# 
# Would be a great visualization to be looking at a graph as a tree with its branches and trunk and all that, and then with some option to step back into a larger, containg tree, the map holds its structure while the visualization converts to a leaf, then zooms out to the tree.
# 
# Like the oak leaf having the same structure as the oak tree.
# The address goes:
# 
# tree # 0
# generation # 5
# sibling # 3
# 
# granddaughters, cousings, great uncles can all be determines from that.
# Collab rules:
# 
# If making a selection of multiple nodes or clicking and dragging a single node, the movement locks the position to the first user to make the connection to the server
# 
# Text within a node is blocked out, maybe by line, maybe by punctuation (likely by span) so that editors can work closely, but...
# 
# oh shit
# 
# highlight the part you want to temporarily lock
# 
# like you can edit all you want
# 
# but if you want to prevent someone from stepping on your toes in a 4 paragaph section, you highlight it and temporarily 'protect it'
# 
# like Minecraft World Edit
# If trees are intersecting/intertwined between the rendering engine and the data layer and the system layer, those trees can exist in different dimensions. 3 dimensional layers.
# 
# Ghosts and demons.
# Information Silos
# Filter Bubbles
# Walled Gardens
# Based on the fact that you fork the source code to run an application on your local machine, you will never be forced to upgrade to a new user interface that someone else designed and implemented without asking. New nodes are offered, and people
# Dare the hackers to bring the system down. See if their presence is noted by the visualization, see if their activity is realized as suspect, if they manage to break in and the system notices, immediately boot into safe mode. no connection to the outside world, but the box you hosted is right in front of you, so, read the logs
# 
# this encourages hosts to use their domain server as their daily driver, so that if a break in happens, they have really, truly private access to the logs so they can discover what files were accessed, what files were transfered, what system requests were fulfilled.
# 
# If your data server is hacked and you need an open IP connection to fix it you're screwed.
# 
# Abstinence is the only 100% effective method to prevent pregnancy
# 
# Absinthe is something else entirely
# Plain text (Which exist as lists themselves based on their newline terminators, it's just that when you're typing inside a leaf and hit enter you keep the sibling in that leaf
# 
# hitting return twice creates a new branch, relative to that. Like this structure is fractal, and certain decisions are made when to expose it, split it, and reconbine it.
# Is the fancy bezeir curve just a simple sinosoidal transformation of a line? Certainly in the horizontal direction, but vertical?
# Activity, audience, response, many metrics to affect the rendering of the textrees.
# 
# In a reddit slashdot setting, the user can pick parameters to filter by
# 
# hide comments with certain metadata (lang, for instance)
# It will be the world that you have full control over, like the situationists always wanted. The augmented reality nature is extreme.
# The traffic entities will materialize however you decide to render that category of traffic (trusted users / anonymous users / suspect users making strange, hackish requests)
# By using a procedural, programmatic structure to do our data organzation and data searches, AI has way more metrics to follow to learn that process
# It will absolutely be that weird future where you enter the computer with all of your senses to experience the data differently, to have unique, otherwise unknowable experiences in ACTUAL NATURE, not constructions, simulations, artistic visions, but an actual living breathing durable-ephemeral environment buzzing with life real and unreal. Avatars will be available as people you trust and possibly as computers you trust. You get to decide how the data is presented. Maybe you want the machine algorithms to literally be spiders so you can see where they're crawling. Or maybe you want them to appear as human as you do (or maybe you want to be a spider)
# 
# This is all way more interesting when each individual has the power to design their own appearence and the appearence of others.
# 
# You can choose to use a person's requested skin, or you can reskin them to your liking so they look like however you want.
# 
# Maybe those think tanks from Ghost in the Shell
# 
# Maybe you want your visitors to appear as ghosts. Or butterflies. As they peruse your domain.
# 
# Shapeshifters according to behavoir.
# 
# Whoa, visual feedback on how users are acting.
# 
# It would be a special experience to know that you're all looking at the same thing, but a special priveldge to reskin the world to your liking
# 
# as well you can collaboratively build skins that you all like
# 
# meanwhile, hopefully, the outside world remains just as brilliant and appreciated
# 
# I think if the computer world is kept aethetically separate as possible, without bitmaps and video streams and uncanny valley weirdness, AR will be where its at
# 
# Keep the data tied to the real world.
# 
# Actually, if you close your eyes, you lose information. Absolutely. You lose context and sense of place.
# Different ways of thinking still drop their ideas into the same data type
# 
# the presentation layer allows them to edit it in whatever way they want
# This could be googling with slightly different search results, getting different canopies of results and trying to make sense, one of them is warmer, one of them is colder...send it through a learning filter, a categorization filter, a classifying filter, just sort through the haystack with different tools til you find it.
# 
# The computer will watch you as you try. But it's local. It keeps its data in its own tree (internal data can be in locked gardens. Cloisters, perhaps.)
# It's prohibitively difficult to write code that operates on binary files. It's difficult to understand, difficult to edit, it has no place on a free web, whose ideal is to be accessible, editable, changeable by anyone by offering some restraints to
# Process is like:
# Get a canvas to full screen
# Draw a box on double click that you can type in
# Create a new file when you make a root node
# Append to file when family relationships are created
# Generate markup describing those relationships in the text file
# Create a look up table that associations nodes with their relationships (one to one? list of connections ought to do it)
# Attach location metadata to each node (another 1:1, these can be stored as hashes / dictionaries for performance purposes)
# 
# Far future: some kind of universal socket that really does let you use any language and immediately have that functionality
# 
# so the output of one node can go into another, and its language agnostic (AND CREATOR AGNOSTIC), because its a universal data type. charwise data can be piped between any programs, and this stears people towards unix design principles of building small programs that do one thing well. other people can build interfaces that weave that code together.
# Instead of opening new tabs and spending context-switching time trying to find the tab you were just in, you can just pull in new trees, keep the information you want at your finger tips, push the old information away, but it stays there, for when you go for a stroll. nothing is lost. You can even go back in time and watch the data rearrange around you.
# In private message, a sort of linear mode streamlined for one to one conversation, branching doesn't happen all that often, althoug if you want to branch a conversation into separate topics you certainly could
# 
# actually that would be huge
# 
# and disruptive
# 
# anyway the point way
# Collaborative Journalism
# 
# A skeleton article can be pushed
# 
# people can make comments
# speculation
# post sources
# post tweet like things, whatever
# 
# the owner of the domain can merge those sidechains into the mainline. Other distribors can decide if they want to auto-update to the latest version of the story or if they want to fork
# 
# People could even see multiple threads of the story
# 
# Everything always with the original author's signature [say someone copy pastes it - it can quickly be compared with earlier timestamped versions and thrown out as forgery. If someone changes it enough that forge-rhythms don't catch it, fine, it's a paraphrase, whatever, but it's less valuable because it broke the tree
# 
# everything always super secure
# 
# so whistleblowers and people on ground zero can mingle in the same digital space as the onlookers. They don't have to hide in nebulous onionspace.
# oh, and this is super congruent with folding at home. Packets, distribution, visualization, puzzles
# You open the browser, enter the domain and your login credentials that are associated with your access key
# 
# maybe you have the ability to ask for anonymous keys, which is just like being a guest. Limited privelege, everyone can see that you're a guest
# 
# Or you can request to become a user, who is handed keys for certain permissions (maybe it is necessary to have these credentials even to clone a tree, so that your local modifications can be pushed back to the main trunk)
# 
# You can log in as different users/identities with different permissions if you wish
# 
# But that little 3 part address bar with autofill / keyring / 2 factor authetication is your way around a secure web
# Oh and I can't wait to share the content of a good article while stripping it from the shitty context of its clickbait host
# 
# the original author's signature will remain signed on that content.
# I just want to make it clear that no one has a right to push data in front of someone else
# 
# you can say that it is some social contract that by accessing your host, it is polite of me to use your interface, view your linked articles, and download your advertisements, but this is MY computer, and I get to have full control over what goes in and out of it (harkening back to BBS days when there was so little data transfer going on, single threaded machines, you were absolutely aware of what was going in and out. The machinery of the tool is totally exposed with dial up tones and 20 char per second transfer rates (actually over radio and distributed wireless some people can probably relive their BBS glory days)
# And stop making ads look like my friends' content
# 
# talk about rude.
# I was doing research on the tradeoffs between node/graph and code block visual language and plain text language
# For rich text textrees the source code has the option of using different markup languages. LaTeX, HTML/CSS, MarkUp et al. No markup is assumed until a user types tags, maybe <em> or *bold* or /command - something distictive to a language, and then everything from there on out is formatted with that markup. WYSIWYG is possible, like you can highlight text and hit link and text^ and all that, the buttons appearing and the editing capabilities being a matter of your rendering engine.
# Regarding updates, you could potentially set up a schedule: synchronize trees at midnight. Or various times for load balancing purposes. Good microwave connections should not be split up to make 1000 people wait for slow as shit internet, it should be metered out direct, so using a computer is a reliable, enjoyable expereince
# 
# I hate that people are sitting in front of blank screens waitinf for machine to load
# 
# the machines are meant to wait for you!
# It's so stupid that I have to rely on my wifi and a thousand other factors just to look at messages that i was JUST looking at
# XML parser
# hide an item in one entity as uninteresting and all those items are hidden
# 
# file whittles down real quick
# I was whistling and twiddling with my demonstration lock.
# 
# Mother fuckin pin tumbler training lock with a tiny pressure sensor at the top of each spring that correlates with a tone of a chord, 1,3,5,7,9, whatever, loudness corresponds to percentage of maximum force, as force overflows boundry, crunchy filters are applied to make it obvious something is overset, or crooked etc - but crucially, it signals WHICH pin. The program can be modified to suit the user. Different 'keys' of chords can be programmed so make it possible to play little tunes with your lock pick, if you have enough dexterity.
# 
# Otherwise, even a key scraping in and out would make a cute little chime
# 
# Actually, if several keys could open the same lock, a musical lock would detect which key was opening, leading to interesting identity-reactive automation options for access to other locks, metrics, personel logging, etc.
# 
# Outfitted with sensors to measure not only the compression of the spring, but the direction of the pressure of the spring. A bind pin's spring will put pressure in a different direction than a pin that can move freely up and down.
# 
# A smart lock with at least as much security as a physical lock. A physical key MUST be present to move the pins.
# 
# GPL'd license. I retain rights to my trademark, but you can copy and modify my design, but you have to give your design away too, or I'll sue for all you're worth.
# 
# LockPick Orchestra
# 
# Easy prototype option might be to backlight the lock you got, focus a camera on the pins that should appear as black boxes moving up and down
# 
# And of course the patent application will be created with textrees. Engineering drawings can be modified, updated, reproduced, rendered differently. Print to PDF.
# 
# If it was obvious how smart it was they wouldn't have to stick it in the name.
# 
# Tiny pressure sensors above the springs, or possibly using the springs as a capacitor. I think that should work.
# 
# The surface area of the spring in conjunction with the distance of that surface from the electron source determines a measurable capacitance
# regarding machines running at a billion cycles a second. Waiting for user input should their main occupation.
# I didn't coin the word textree. Arborists/Nurseries in Texas were first to the punch, followed by various computer programmers who started a project concerned with the graphical representation of text organization (as I am),
# 
# and I wasn't the first to use a tree as a first class data type with lots of functions to operate on
# 
# But perhaps I'm the first to see plain textrees as a perfectly good data type to represent and operate on all kinds of data, from tables of product and POS data to point clouds, web forms, and music synthesizers.
# Can there be "A Really Useful Book" somewhere?
# 
# Like, that's the tree which is the manual?
# Okay
# 
# Perhaps, there's a simple workaround to allow for sharing photographs
# 
# Your domain can be queryed for its features
# 
# what are the domain rules? laws of physics style
# 
# Whether embedded content is supported on your domain can be a bit of a red flag. Like, oh, image board, yuck, nothing but memes and gore, awful, clunky formatting.
# 
# So it's a social capital thing to run a domain free of embedded content. Straight edge freedom. Charwise unbroken textrees.
# 
# (Stupid thing about embedded content is it can't be so easily rehosted, forked, merged, etc. So a domain that embeds content is necessarily less free.)
# TODO:
# 
# take mouse coordinates at mousedown, move element relative
# 
# figure out the mousedown/mousemove/mouseup situation so it doesn't bug out
# If you want to change the world
# 
# you create a viral protocol
# You should clone the sourcecode now so it's too late to put back in the box
# 
# Maybe someone will arrest me, I'm sure I'm stepping on a few toes, so here's a QR code to my bitcoin wallet.
# 
# I don't have access to this wallet, but my lawyer does. Escrow account with the Free Software Foundation, or Electronic Fronteir Foundation, or hell, both
# 
# you bet your ass I intend to infringe some software patents
# Cell phone ISPs have no interest in cutting down on the amount of data you use
# 
# opening my email just took 9MB
# 
# I already looked at my email, there were no changes from 3 hours ago.
# On page load, 4 files are weaved together
# SetupTree - creates environment variables, points to other files?
# TexTree - content with id
# StyleTree - CSS
# BehavoirTree - JS
# StrucTree - DOM layout rules,
# possibly the same as behavoir
# 
# actually leaves as they get added could simply be tagged as 'div','style',or 'script'
# Vocal intonation and timing patterns embedded in the text to denote accent, vocal intonation denoting emotion, sarcasm, and other structures that are taken for granted to be lost in written word but don't have to be. They can be embedded in diacritics and metatags and timestamps
# 
# this would allow an accent to be modified, or a machine translator to infer alternative, less common uses of phrases, and to convert emotional syntax into the local cultural context
# 
# Then we will have real time, emotive, realistic, unique, design your own voice real time on the fly translation
# As abstractions build up and the dirt needs less upkeep, I can literally push the code into the ground.
# 
# The plane of nodes I'm looking at is actually an XY cross section of  of my tree.
# 
# As I add bytes, the girth of that branch embiggens. The rings in the 'log' represent revisions, and can be local to the current layer.
# 
# So this would consist of a rendering layer that controls what my raw data looks like, aside from a rendering layer
# Code to get binaries and bitmaps into and out of the system will remain underneath or on top of the system.
# Oh shit default plane if forest floor. The guts of the computer get pushed underground. The canopy/output of a certain system layer becomes the roots and the input and the functionality of the entire system can be abstracted as the starting node of the next layer
# Super sweet augmented reality applications by using geolocations to tag information. Cell phone radios can triangulate eachothers position in space to get a bearing on relative position, then content creation on the forest floor
# Funny necessity of high dimensions: all labels are relative to their context. Root, Leaf, Canopy, Bud, Branch, Vein.
# 
# It's just like Child,Parent,Grandparent. We do it all the time, you just need to keep track of who the center of the relationship is.
# There won't be any goddamn sync errors, because
# functions with multiple languages can be a thing. Maybe someone wants to simply translate the documentation, so now a function can be used by people who speak multiple languages
# A Very Good Thing for psuedocoding and code blocks. People who don't speak english or even know the english alphabet can create graphs of code blocks that contain english language languages simply by their native language documentation that expliains the capabilities, datatype, and input/output protocal.
# Seeing that flash animation of the combination lock inspired this, plain text interactive elements. That flash is going out of date, that wonderful animated explanation of a hard to grasp thing is going to break someday, already on many computers that have moved from flash.
# 
# charwise data is futureproof data
# you can wrap up R and Swift in here and call it a day
# 
# LaTeX formulas can be translated into functions: break out the inputs, connect data to the equations and play
# 
# holy shit new scientific papers where the equations (which no one has any right to understand on first glance, they are designed algorithms used by the experiment)
# You know that meme in those detective movies where dude is pinning little clues to the wall, and the running strings between them?
# 
# Well what if actually you could write notes on note cards, put it into a converted timestamp machine that scans it, timestamps it, and dispenses a magnet with RFID that will be associated with that time stamp.
# 
# 
# Then, a 2 (XZ) axis CNC arm with a hall effect sensor listens for an acoustic click and pinpoints the new position of the data
# 
# inductively charging the magnets, listening for the path that charge takes, the computer could detect how things are connected
# 
# including overlapping strings
# 
# or strings could be wrapped in nonbraided cord to make them nonconductive
# Make it easy to connect to a server, DDOS it, throw a rainbow table at it, from a secure distance hosted on someone elses cloud, autoscaling, pulling from bitcoin wallet, whatever you want it is now easy for anyone to exploit.
# 
# People would use the system I created to attack ... go after people with a lot of resource. go after governments and corporations. Maybe governments would use it against other governments or themselves to show everyone what a dangerous tool it is and how anyone using it is definitely a criminal.
# 
# This whole mess is already compromised if my system is sending keylogged information back to microsoft
# Yeah, what's the legality of demonstrating how much your competitors' products suck by teaching people to gain unauthorized access? Maybe... I'm just very clear that I'm not selling lock picking tools for would be criminals. I'm selling locks for would be victims.
# That anon aethetic of autogenerated voices
# 
# but way more interesting
# Machine translation can be the inital commit to a foreign language. As users pick it up and try to understand it, BILINGUAL OR NOT, they can fork the documentation to clarify and correct the translation. The documentation does not start empty, but it does not stay machine. NEGROPONTE
# More interestingly, people who speak languages other than english can create a custom function and contribute it to multilingual audience. At first, maybe it's mysterious because most english dudes don't read traditional chinese,
# highlight text, click shortcut to push up, down, or side to side
# 
# to smoothly flow text around trees
# it would be as chaotic as if people started teaching lockpicking in public
# 
# suddenly everyone might buy new locks
# If muh-fuggin mechanical and algorithm patents can be previewed, forked, animated, made interactive, made copy pastable and parametric
# 
# might as well call the whole thing off
# Encrypted files, that are provable unedited and provably timestamped
# 
# prior art, patents, various legal disputes, contracts
# 
# Oh I guess blockchain would be useful for this
panel_8 = Panel("TuneKey Tumbler")
